# Dynamo graph Journalysis_NodeBased.dyn (Dynamo 1.3.1.1736)

# group: INPUT
file_path = Filename("..\..\..\..\AppData\Local\Autodesk\Revit\Autodesk Revit 2016\Journals\journal.0087.txt")

# group: Journal.Create
fromPath = FileObject(file_path)  # "File.FromPath"
readText = File.ReadText(fromPath)
# note: QUESTION:
# Does the graph execute okay? Do any nodes turn yellow?
byString = Custom[Journal.ByString](str=readText)

# group: JournalMiscCommand TEST
string = StringInput("JournalMiscCommand")  # frozen
getLinesByType = Custom[Journal.GetLinesByType](journal=byString, journalLineType=string)
rawText = Custom[JournalLine.RawText](journalLine=getLinesByType)
watch = Watch(rawText)
string_2 = StringInput(" ")
split = String.Split(rawText, string_2)
transpose = List.Transpose(split)
firstItem = List.FirstItem(transpose)
groupByKey = List.GroupByKey(list=rawText, keys=firstItem)
# note: QUESTION:
# Do you see more than three items in this list? (Dim, Set, Jrn.Size)
watch_2 = Watch(groupByKey.unique_keys)
watch_3 = Watch(groupByKey.groups)

# group: JournalDirective.Query
string_3 = StringInput("JournalDirective")
getLinesByType_2 = Custom[Journal.GetLinesByType](journal=byString, journalLineType=string_3)
values = Python(IN[0]=getLinesByType_2)  # "JournalDirective.Values"
# ---------- values.python (11 lines) ----------
import clr

def process_input(func, input):
	if isinstance(input, list): return [func(x) for x in input]
	else: return func(input)
	
def journalDirectiveValues(input):
	if input.__repr__() == 'JournalDirective': return input.Values
	else: return []

OUT = process_input(journalDirectiveValues,IN[0])
# ----------------------------------------
key = Python(IN[0]=getLinesByType_2)  # "JournalDirective.Key"
# ---------- key.python (11 lines) ----------
import clr

def process_input(func, input):
	if isinstance(input, list): return [func(x) for x in input]
	else: return func(input)
	
def journalDirectiveKey(input):
	if input.__repr__() == 'JournalDirective': return input.Key
	else: return None

OUT = process_input(journalDirectiveKey,IN[0])
# ----------------------------------------

# group: JournalMouseEvent.Query
string_4 = StringInput("JournalMouseEvent")
getLinesByType_3 = Custom[Journal.GetLinesByType](journal=byString, journalLineType=string_4)
data = Python(IN[0]=getLinesByType_3)  # "JournalMouseEvent.Data"
# ---------- data.python (9 lines) ----------
import clr

lines = IN[0]
OUT = []
for line in lines:
	if line.Type == "JournalMouseEvent":
		OUT.append(line.Data)
	else:
		OUT.append([])
# ----------------------------------------
mouseEventType = Python(IN[0]=getLinesByType_3)  # "JournalMouseEvent.MouseEventType"
# ---------- mouseEventType.python (9 lines) ----------
import clr

lines = IN[0]
OUT = []
for line in lines:
	if line.Type == "JournalMouseEvent":
		OUT.append(line.MouseEventType)
	else:
		OUT.append(None)
# ----------------------------------------

# group: JournalGUIResourceUsage.Query
string_5 = StringInput("JournalGUIResourceUsage")
getLinesByType_4 = Custom[Journal.GetLinesByType](journal=byString, journalLineType=string_5)
available = Python(IN[0]=getLinesByType_4)  # "JournalGUIResourceUsage.Available"
# ---------- available.python (9 lines) ----------
import clr

lines = IN[0]
OUT = []
for line in lines:
	if line.Type == "JournalGUIResourceUsage":
		OUT.append(line.Available)
	else:
		OUT.append(None)
# ----------------------------------------
used = Python(IN[0]=getLinesByType_4)  # "JournalGUIResourceUsage.Used"
# ---------- used.python (9 lines) ----------
import clr

lines = IN[0]
OUT = []
for line in lines:
	if line.Type == "JournalGUIResourceUsage":
		OUT.append(line.Used)
	else:
		OUT.append(None)
# ----------------------------------------
user = Python(IN[0]=getLinesByType_4)  # "JournalGUIResourceUsage.User"
# ---------- user.python (9 lines) ----------
import clr

lines = IN[0]
OUT = []
for line in lines:
	if line.Type == "JournalGUIResourceUsage":
		OUT.append(line.User)
	else:
		OUT.append(None)
# ----------------------------------------

# group: JournalUIEvent.Query
string_6 = StringInput("JournalUIEvent")
getLinesByType_5 = Custom[Journal.GetLinesByType](journal=byString, journalLineType=string_6)
UIEventType = Python(IN[0]=getLinesByType_5)  # "JournalUIEvent.UIEventType"
# ---------- UIEventType.python (9 lines) ----------
import clr

lines = IN[0]
OUT = []
for line in lines:
	if line.Type == "JournalUIEvent":
		OUT.append(line.UIEventType)
	else:
		OUT.append(None)
# ----------------------------------------
data_2 = Python(IN[0]=getLinesByType_5)  # "JournalUIEvent.Data"
# ---------- data_2.python (9 lines) ----------
import clr

lines = IN[0]
OUT = []
for line in lines:
	if line.Type == "JournalUIEvent":
		OUT.append(line.Data)
	else:
		OUT.append([])
# ----------------------------------------

# group: JournalMemoryMetrics.Query
string_7 = StringInput("JournalMemoryMetrics")
getLinesByType_6 = Custom[Journal.GetLinesByType](journal=byString, journalLineType=string_7)
VMAvailable = Python(IN[0]=getLinesByType_6)  # "JournalMemoryMetrics.VMAvailable"
# ---------- VMAvailable.python (9 lines) ----------
import clr

lines = IN[0]
OUT = []
for line in lines:
	if line.Type == "JournalMemoryMetrics":
		OUT.append(line.VMAvailable)
	else:
		OUT.append(None)
# ----------------------------------------
VMUsed = Python(IN[0]=getLinesByType_6)  # "JournalMemoryMetrics.VMUsed"
# ---------- VMUsed.python (9 lines) ----------
import clr

lines = IN[0]
OUT = []
for line in lines:
	if line.Type == "JournalMemoryMetrics":
		OUT.append(line.VMUsed)
	else:
		OUT.append(None)
# ----------------------------------------
VMPeak = Python(IN[0]=getLinesByType_6)  # "JournalMemoryMetrics.VMPeak"
# ---------- VMPeak.python (9 lines) ----------
import clr

lines = IN[0]
OUT = []
for line in lines:
	if line.Type == "JournalMemoryMetrics":
		OUT.append(line.VMPeak)
	else:
		OUT.append(None)
# ----------------------------------------
RAMAvailable = Python(IN[0]=getLinesByType_6)  # "JournalMemoryMetrics.RAMAvailable"
# ---------- RAMAvailable.python (9 lines) ----------
import clr

lines = IN[0]
OUT = []
for line in lines:
	if line.Type == "JournalMemoryMetrics":
		OUT.append(line.RAMAvailable)
	else:
		OUT.append(None)
# ----------------------------------------
RAMUsed = Python(IN[0]=getLinesByType_6)  # "JournalMemoryMetrics.RAMUsed"
# ---------- RAMUsed.python (9 lines) ----------
import clr

lines = IN[0]
OUT = []
for line in lines:
	if line.Type == "JournalMemoryMetrics":
		OUT.append(line.RAMUsed)
	else:
		OUT.append(None)
# ----------------------------------------
RAMPeak = Python(IN[0]=getLinesByType_6)  # "JournalMemoryMetrics.RAMPeak"
# ---------- RAMPeak.python (9 lines) ----------
import clr

lines = IN[0]
OUT = []
for line in lines:
	if line.Type == "JournalMemoryMetrics":
		OUT.append(line.RAMPeak)
	else:
		OUT.append(None)
# ----------------------------------------

# group: JournalTimeStamp.Query
string_8 = StringInput("JournalTimeStamp")
getLinesByType_7 = Custom[Journal.GetLinesByType](journal=byString, journalLineType=string_8)
timeStampType = Python(IN[0]=getLinesByType_7)  # "JournalTimeStamp.TimeStampType"
# ---------- timeStampType.python (9 lines) ----------
import clr

lines = IN[0]
OUT = []
for line in lines:
	if line.Type == "JournalTimeStamp":
		OUT.append(line.TimeStampType)
	else:
		OUT.append(None)
# ----------------------------------------
dateTime = Python(IN[0]=getLinesByType_7)  # "JournalTimeStamp.DateTime"
# ---------- dateTime.python (9 lines) ----------
import clr

lines = IN[0]
OUT = []
for line in lines:
	if line.Type == "JournalTimeStamp":
		OUT.append(line.DateTime)
	else:
		OUT.append(None)
# ----------------------------------------
description = Python(IN[0]=getLinesByType_7)  # "JournalTimeStamp.Description"
# ---------- description.python (9 lines) ----------
import clr

lines = IN[0]
OUT = []
for line in lines:
	if line.Type == "JournalTimeStamp":
		OUT.append(line.Description)
	else:
		OUT.append(None)
# ----------------------------------------

# group: Journal.Query
version = Custom[Journal.Version](journal=byString)
user_2 = Custom[Journal.User](journal=byString)
loadedModels = Custom[Journal.LoadedModels](journal=byString)
lineCount = Custom[Journal.LineCount](journal=byString)
blockCount = Custom[Journal.BlockCount](journal=byString)
lines = Custom[Journal.Lines](journal=byString)

# group: Test Inputs
code_block = CodeBlock { {"JournalData","JournalDirective"}; "JournalData"; }
code_block_2 = CodeBlock { 30..34; 33; }

# group: Journal.Actions
getLinesByType_8 = Custom[Journal.GetLinesByType](journal=byString, journalLineType=code_block.out0)
getLinesByBlock = Custom[Journal.GetLinesByBlock](journal=byString, journalBlock=code_block_2.out0)

# group: JournalKeyboardEvent.Query
string_9 = StringInput("JournalKeyboardEvent")
getLinesByType_9 = Custom[Journal.GetLinesByType](journal=byString, journalLineType=string_9)
key_2 = Python(IN[0]=getLinesByType_9)  # "JournalKeyboardEvent.Key"
# ---------- key_2.python (9 lines) ----------
import clr

lines = IN[0]
OUT = []
for line in lines:
	if line.Type == "JournalKeyboardEvent":
		OUT.append(line.Key)
	else:
		OUT.append(None)
# ----------------------------------------

# group: JournalData.Query
string_10 = StringInput("JournalData")
getLinesByType_10 = Custom[Journal.GetLinesByType](journal=byString, journalLineType=string_10)
key_3 = Python(IN[0]=getLinesByType_10)  # "JournalData.Key"
# ---------- key_3.python (11 lines) ----------
import clr

def process_input(func, input):
	if isinstance(input, list): return [func(x) for x in input]
	else: return func(input)
	
def journalDataKey(input):
	if input.__repr__() == 'JournalData': return input.Key
	else: return None

OUT = process_input(journalDataKey,IN[0])
# ----------------------------------------
values_2 = Python(IN[0]=getLinesByType_10)  # "JournalData.Values"
# ---------- values_2.python (11 lines) ----------
import clr

def process_input(func, input):
	if isinstance(input, list): return [func(x) for x in input]
	else: return func(input)
	
def journalDataValues(input):
	if input.__repr__() == 'JournalData': return input.Values
	else: return []

OUT = process_input(journalDataValues,IN[0])
# ----------------------------------------

# group: JournalLine.Query
number = Custom[JournalLine.Number](journalLine=lines)
type = Custom[JournalLine.Type](journalLine=lines)
block = Custom[JournalLine.Block](journalLine=lines)
rawText_2 = Custom[JournalLine.RawText](journalLine=lines)

# group: JournalComment TEST
string_11 = StringInput("JournalComment")  # frozen
getLinesByType_11 = Custom[Journal.GetLinesByType](journal=byString, journalLineType=string_11)
rawText_3 = Custom[JournalLine.RawText](journalLine=getLinesByType_11)
string_12 = StringInput(" ")
split_2 = String.Split(rawText_3, string_12)
transpose_2 = List.Transpose(split_2)
firstItem_2 = List.FirstItem(transpose_2)
groupByKey_2 = List.GroupByKey(list=rawText_3, keys=firstItem_2)
# note: QUESTION:
# Would you like to be able to pull any of this data from the journal file?
watch_4 = Watch(groupByKey_2.unique_keys)
watch_5 = Watch(groupByKey_2.groups)
watch_6 = Watch(rawText_3)

# group: JournalLineTypes
all = Custom[JournalLineTypes.All]()
watch_7 = Watch(all)

# group: JournalAddinEvent.Query
string_13 = StringInput("JournalAddinEvent")
getLinesByType_12 = Custom[Journal.GetLinesByType](journal=byString, journalLineType=string_13)
text = Custom[JournalAddinEvent.MessageText](journalAddinEvent=getLinesByType_12)  # "JournalAddinEvent.Text"

# group: Python Examples
# note: Extract unique list of API error messages
python_script = Python(IN[0]=byString)
# ---------- python_script.python (6 lines) ----------
import clr

OUT = []
if IN[0].__repr__() == 'Journal':
	allAPImsgs = IN[0].GetLinesByType('JournalAPIMessage')
	OUT = set([x.MessageText for x in allAPImsgs if x.MessageType == 'Error'])
# ----------------------------------------
watch_8 = Watch(python_script)
# note: Extract unique list of commands triggered by a keyboard shortcut
python_script_2 = Python(IN[0]=byString)
# ---------- python_script_2.python (6 lines) ----------
import clr

OUT = []
if IN[0].__repr__() == 'Journal':
	allJCommands = IN[0].GetLinesByType('JournalCommand')
	OUT = set([x.CommandID for x in allJCommands if x.CommandType == 'KeyboardShortcut'])
# ----------------------------------------
watch_9 = Watch(python_script_2)

# group: JournalAPIMessage.Query
string_14 = StringInput("JournalAPIMessage")
getLinesByType_13 = Custom[Journal.GetLinesByType](journal=byString, journalLineType=string_14)
text_2 = Custom[JournalAPIMessage.Text](journalAPIMessage=getLinesByType_13)
type_2 = Custom[JournalAPIMessage.Type](journalAPIMessage=getLinesByType_13)

# group: JournalCommand.Query
string_15 = StringInput("JournalCommand")
getLinesByType_14 = Custom[Journal.GetLinesByType](journal=byString, journalLineType=string_15)
type_3 = Custom[JournalCommand.Type](journalCommand=getLinesByType_14)
description_2 = Custom[JournalCommand.Description](journalCommand=getLinesByType_14)
ID = Custom[JournalCommand.ID](journalCommand=getLinesByType_14)
