# Dynamo custom node Journal.LoadedAssemblies.dyf (Dynamo 1.3.1.1736)
# category: Journalysis.Journal.Actions
# Pulls a list of all loaded assemblies (i.e. addin DLLs) from a given journal

journal = Input()
python_script = Python(IN[0]=journal)
# ---------- python_script.python (11 lines) ----------
import clr

def process_input(func, input):
	if isinstance(input, list): return [func(x) for x in input]
	else: return func(input)
	
def journalLoadedAssemblies(journal):
	if journal.__repr__() == 'Journal': return journal.GetLoadedAssemblies()
	else: return None

OUT = process_input(journalLoadedAssemblies,IN[0])
# ----------------------------------------
seq = Output(python_script)
